# Dynamo graph BenchBake.dyn (Dynamo 1.0.0.1180)

code_block = CodeBlock()
# ---------- code_block.designscript (24 lines) ----------
def height() { return = 1/12;
 };
def depth() { return = 1/12;
};
def spacing() { return = 1/12;
 };
def tFront() { return = 3/8/12;
};
def tBack() { return = 3/8/12;
};
def minOffset() { return = 1/8/12;
 };
def cornerOffset() { return = 1/8/12;
};
def rFillet() { return = 1/2/12;
 };
def angle() { return = 0;
};
def rHole() { return = 1/8/12;
};
def rPocket() { return = 5/25.4/12;
};
def nConnectors() { return = 1;
};
# ----------------------------------------
file_path = Filename(".\Bench.sat")
importFromSAT = Geometry.ImportFromSAT(file_path)
scaleSAT = Geometry.math.ScaleSAT(importFromSAT)
bySurfaces = Topology.mesh.BySurfaces(scaleSAT)
code_block_2 = CodeBlock()
# ---------- code_block_2.designscript (12 lines) ----------
height();
depth();
spacing();
tFront();
tBack();
minOffset();
cornerOffset();
rFillet();
angle();
rHole();
rPocket();
nConnectors();
# ----------------------------------------
byMeshParametersHole = Panelization.panelSystem.ByMeshParametersHole(bySurfaces, code_block_2.out0, code_block_2.out1, code_block_2.out2, code_block_2.out3, code_block_2.out4, code_block_2.out5, code_block_2.out6, code_block_2.out7, code_block_2.out8, code_block_2.out9, code_block_2.out10, code_block_2.out11)
panels = Panelization.panelSystem.Panels(byMeshParametersHole)
getPanelHoleSolid = Panelization.panelHole.GetPanelHoleSolid(panels)
connectors = Panelization.panelSystem.Connectors(byMeshParametersHole)
getConnectorHoleSolids = Panelization.connectorHole.GetConnectorHoleSolids(connectors)
