# Dynamo graph BenchDXF.dyn (Dynamo 1.0.0.1180)

code_block = CodeBlock()
# ---------- code_block.designscript (24 lines) ----------
def height() { return = 1/12;
 };
def depth() { return = 1/12;
};
def spacing() { return = 1/12;
 };
def tFront() { return = 3/8/12;
};
def tBack() { return = 3/8/12;
};
def minOffset() { return = 1/8/12;
 };
def cornerOffset() { return = 1/8/12;
};
def rFillet() { return = 1/2/12;
 };
def angle() { return = 0;
};
def rHole() { return = 1/8/12;
};
def rPocket() { return = 5/25.4/12;
};
def nConnectors() { return = 1;
};
# ----------------------------------------
byDefault = Fabrication.DXF.ByDefault()
file_path = Filename("..\Blender\bench.sat")
importFromSAT = Geometry.ImportFromSAT(file_path)
scaleSAT = Geometry.math.ScaleSAT(importFromSAT)
bySurfaces = Topology.mesh.BySurfaces(scaleSAT)
code_block_2 = CodeBlock()
# ---------- code_block_2.designscript (12 lines) ----------
height();
depth();
spacing();
tFront();
tBack();
minOffset();
cornerOffset();
rFillet();
angle();
rHole();
rPocket();
nConnectors();
# ----------------------------------------
byMeshParametersHole = Panelization.panelSystem.ByMeshParametersHole(bySurfaces, code_block_2.out0, code_block_2.out1, code_block_2.out2, code_block_2.out3, code_block_2.out4, code_block_2.out5, code_block_2.out6, code_block_2.out7, code_block_2.out8, code_block_2.out9, code_block_2.out10, code_block_2.out11)
panels = Panelization.panelSystem.Panels(byMeshParametersHole)
getPanelProfile = Panelization.panel.GetPanelProfile(panels)
CS = Panelization.panel.CS(panels)
count = Count(panels)
code_block_3 = CodeBlock(c=count) { c-1; }
range = Range(end=code_block_3, lacing=Longest)
code_block_4 = CodeBlock { 3; 15; }
mapPolyCurve = Fabrication.MaptoXY.MapPolyCurve(getPanelProfile, CS, range, code_block_4.out0, code_block_4.out1, code_block_4.out0)
code_block_5 = CodeBlock { "CUT"; 6; }
addCurvesAsArcLineXY = Fabrication.DXF.AddCurvesAsArcLineXY(arg1=mapPolyCurve, arg2=code_block_5.out0, arg3=code_block_5.out1)
code_block_6 = CodeBlock { 1/8/12; }
getEdgeLabelsBack = Panelization.panel.GetEdgeLabelsBack(panels, code_block_6)
mapPolyCurves = Fabrication.MaptoXY.MapPolyCurves(getEdgeLabelsBack, CS, range, code_block_4.out0, code_block_4.out1, code_block_4.out0)
code_block_7 = CodeBlock { "LABELS"; 1; }
addCurvesAsArcLineXY_2 = Fabrication.DXF.AddCurvesAsArcLineXY(arg1=mapPolyCurves, arg2=code_block_7.out0, arg3=code_block_7.out1)
getPanelHoleProfileAsPolyCurve = Panelization.panelHole.GetPanelHoleProfileAsPolyCurve(panels)
file_path_2 = Filename(".\BenchDXF")
writeFile = Fabrication.DXF.WriteFile(arg1=file_path_2)
getPanelHoleProfile = Panelization.panelHole.GetPanelHoleProfile(panels)
mapCurves = Fabrication.MaptoXY.MapCurves(getPanelHoleProfile, CS, range, code_block_4.out0, code_block_4.out1, code_block_4.out0)
code_block_8 = CodeBlock { "HOLES"; 3; }
addCircles = Fabrication.DXF.AddCircles(arg1=mapCurves, arg2=code_block_8.out0, arg3=code_block_8.out1)
mapCircles = Fabrication.MaptoXY.MapCircles(getPanelHoleProfile, CS, range, code_block_4.out0, code_block_4.out1, code_block_4.out0)
