# Dynamo graph BenchSearch.dyn (Dynamo 1.0.0.1180)

file_path = Filename(".\Bench.sat")
importFromSAT = Geometry.ImportFromSAT(file_path)
scaleSAT = Geometry.math.ScaleSAT(importFromSAT)
bySurfaces = Topology.mesh.BySurfaces(scaleSAT)
code_block = CodeBlock()
# ---------- code_block.designscript (12 lines) ----------
height();
depth();
spacing();
tFront();
tBack();
minOffset();
cornerOffset();
rFillet();
angle();
rHole();
rPocket();
nConnectors();
# ----------------------------------------
byMeshParametersHole = Panelization.panelSystem.ByMeshParametersHole(bySurfaces, code_block.out0, code_block.out1, code_block.out2, code_block.out3, code_block.out4, code_block.out5, code_block.out6, code_block.out7, code_block.out8, code_block.out9, code_block.out10, code_block.out11)
panels = Panelization.panelSystem.Panels(byMeshParametersHole)
file_path_2 = Filename("..\bench1.csv")
fromPath = FileObject(file_path_2)  # "File.FromPath"
readFromFile = CSV.ReadFromFile(fromPath)
transpose = List.Transpose(readFromFile)
isNull = Object.IsNull(transpose)
filterByBoolMask = List.FilterByBoolMask(list=transpose, mask=isNull)
code_block_2 = CodeBlock { 1; }
sub = filterByBoolMask.out - code_block_2
getItemAtIndex = List.GetItemAtIndex(list=panels, index=sub)
getPanelSurface = Panelization.panel.GetPanelSurface(getItemAtIndex)
code_block_3 = CodeBlock(T=getPanelSurface) { T[0]; T[1]; T[2]; T[3]; T[4]; T[5]; T[6]; T[7]; T[8]; T[9]; T[10]; T[11]; }
code_block_4 = CodeBlock { 127; {255,191,127,0,0,0,0,0,63}; {0,63,127,255,191,127,0,0,0}; {0,0,0,0,63,127,255,127,191}; }
byARGB = Color.ByARGB(a=code_block_4.out0, r=code_block_4.out1, g=code_block_4.out2, b=code_block_4.out3)
code_block_5 = CodeBlock(T=byARGB) { T[0]; T[1]; T[2]; T[3]; T[4]; T[5]; T[6]; T[7]; T[8]; }
byGeometryColor = Display.Display.ByGeometryColor(code_block_3.out0, code_block_5.out0)
byGeometryColor_2 = Display.Display.ByGeometryColor(code_block_3.out1, code_block_5.out1)
byGeometryColor_3 = Display.Display.ByGeometryColor(code_block_3.out2, code_block_5.out1)
byGeometryColor_4 = Display.Display.ByGeometryColor(code_block_3.out3, code_block_5.out2)
byGeometryColor_5 = Display.Display.ByGeometryColor(code_block_3.out5, code_block_5.out3)
byGeometryColor_6 = Display.Display.ByGeometryColor(code_block_3.out6, code_block_5.out4)
byGeometryColor_7 = Display.Display.ByGeometryColor(code_block_3.out7, code_block_5.out4)
byGeometryColor_8 = Display.Display.ByGeometryColor(code_block_3.out8, code_block_5.out5)
byGeometryColor_9 = Display.Display.ByGeometryColor(code_block_3.out4, code_block_5.out3)
byGeometryColor_10 = Display.Display.ByGeometryColor(code_block_3.out11, code_block_5.out8)
byGeometryColor_11 = Display.Display.ByGeometryColor(code_block_3.out10, code_block_5.out7)
byGeometryColor_12 = Display.Display.ByGeometryColor(code_block_3.out9, code_block_5.out6)
code_block_6 = CodeBlock()
# ---------- code_block_6.designscript (24 lines) ----------
def height() { return = 1/12;
 };
def depth() { return = 1/12;
};
def spacing() { return = 1/12;
 };
def tFront() { return = 3/8/12;
};
def tBack() { return = 3/8/12;
};
def minOffset() { return = 1/8/12;
 };
def cornerOffset() { return = 1/8/12;
};
def rFillet() { return = 1/2/12;
 };
def angle() { return = 0;
};
def rHole() { return = 1/8/12;
};
def rPocket() { return = 5/25.4/12;
};
def nConnectors() { return = 1;
};
# ----------------------------------------
code_block_7 = CodeBlock { 3/16/12; "e"; }
getEdgeLabelsFront = Panelization.panel.GetEdgeLabelsFront(panels, code_block_7.out0, arg3=code_block_7.out1)
code_block_8 = CodeBlock { 3/8/12; }
getFaceLabelFront = Panelization.panel.GetFaceLabelFront(panels, code_block_8)
triangle_search = CodeBlock { {1}; }
code_block_9 = CodeBlock(list=panels, index=triangle_search) { list[index-1]; }
getPanelHoleSolid = Panelization.panelHole.GetPanelHoleSolid(code_block_9)
code_block_10 = CodeBlock { 255; 0; }
byARGB_2 = Color.ByARGB(a=code_block_10.out0, r=code_block_10.out1, g=code_block_10.out1, b=code_block_10.out1)
byGeometryColor_13 = Display.Display.ByGeometryColor(getPanelHoleSolid, byARGB_2)
getLabelsFront = Panelization.panel.GetLabelsFront(code_block_9, code_block_8)
code_block_11 = CodeBlock(code_block_9) { Panel.Face.Normal.ToVector(); tFront(); }
translate = Geometry.Translate(geometry=getLabelsFront, direction=code_block_11.out0, distance=code_block_11.out1)
code_block_12 = CodeBlock { 255; }
byARGB_3 = Color.ByARGB(a=code_block_12, r=code_block_12, g=code_block_12, b=code_block_12)
byGeometryColor_14 = Display.Display.ByGeometryColor(translate, byARGB_3)
