# Dynamo graph SlicerTest.dyn (Dynamo 1.0.0.1180)

code_block = CodeBlock { 10; }
byCenterPointRadius = Sphere.ByCenterPointRadius(radius=code_block)
XAxis = Vector.XAxis()
code_block_2 = CodeBlock { 15; }
translate = Geometry.Translate(geometry=byCenterPointRadius, direction=XAxis, distance=code_block_2)
create = List.Create(byCenterPointRadius, translate)
byUnion = Solid.ByUnion(create)
XY = Plane.XY()
code_block_3 = CodeBlock { 1; 1; }
byPlane = Fabrication.Slicer.ByPlane(byUnion, XY, code_block_3.out0, code_block_3.out1)
getResultsPlaneInscribed = Fabrication.Slicer.GetResultsPlaneInscribed(byPlane)
getResultsPlaneCircumscribed = Fabrication.Slicer.GetResultsPlaneCircumscribed(byPlane)
origin = Point.Origin()
code_block_4 = CodeBlock { 1; 0; }
byCoordinates = Point.ByCoordinates(x=code_block_4.out0, y=code_block_4.out1)
byStartPointEndPoint = Line.ByStartPointEndPoint(startPoint=origin, endPoint=byCoordinates)
byCoordinates_2 = Point.ByCoordinates(x=code_block_4.out1, y=code_block_4.out0)
byStartPointEndPoint_2 = Line.ByStartPointEndPoint(startPoint=origin, endPoint=byCoordinates_2)
byPlaneAndLines = Fabrication.Slicer.ByPlaneAndLines(byUnion, XY, byStartPointEndPoint, byStartPointEndPoint_2)
getResultsLine1 = Fabrication.Slicer.GetResultsLine1(byPlaneAndLines)
getResultsLine2 = Fabrication.Slicer.GetResultsLine2(byPlaneAndLines)
getResultsPlane = Fabrication.Slicer.GetResultsPlane(byPlaneAndLines)
