# Dynamo graph sampleExportEdgeLabel.dyn (Dynamo 0.8.2.1601)

family_types = FamilyTypes("Triangle Rig:Clear")
all_elements_of_family_type = ElementsOfFamilyType(family_types)
family_types_2 = FamilyTypes("Triangle Rig:Solid")
all_elements_of_family_type_2 = ElementsOfFamilyType(family_types_2)
family_types_3 = FamilyTypes("Triangle Rig:Base")
all_elements_of_family_type_3 = ElementsOfFamilyType(family_types_3)
create = List.Create(all_elements_of_family_type, all_elements_of_family_type_2, all_elements_of_family_type_3)
number = DoubleInput(1)
flatten = List.Flatten(list=create, amt=number)
geometry = Element.Geometry(flatten)
locations = AdaptiveComponent.Locations(flatten)
element_types = ElementTypes("CurveElement")
all_elements_of_type = ElementsOfType(element_types)
curve = CurveElement.Curve(all_elements_of_type)
select_model_element = DSModelElementSelection()  # 1 picked in the model
point = ReferencePoint.Point(select_model_element)
select_model_elements = DSModelElementsSelection()  # 1 picked in the model
point_2 = ReferencePoint.Point(select_model_elements)
select_model_element_2 = DSModelElementSelection()  # 1 picked in the model
point_3 = ReferencePoint.Point(select_model_element_2)
select_model_element_3 = DSModelElementSelection()  # 1 picked in the model
point_4 = ReferencePoint.Point(select_model_element_3)
select_model_element_4 = DSModelElementSelection()  # 1 picked in the model
point_5 = ReferencePoint.Point(select_model_element_4)
select_model_element_5 = DSModelElementSelection()  # 1 picked in the model
point_6 = ReferencePoint.Point(select_model_element_5)
select_model_element_6 = DSModelElementSelection()  # 1 picked in the model
point_7 = ReferencePoint.Point(select_model_element_6)
select_model_elements_2 = DSModelElementsSelection()  # 1 picked in the model
point_8 = ReferencePoint.Point(select_model_elements_2)
select_model_element_7 = DSModelElementSelection()  # 1 picked in the model
point_9 = ReferencePoint.Point(select_model_element_7)
select_model_element_8 = DSModelElementSelection()  # 1 picked in the model
point_10 = ReferencePoint.Point(select_model_element_8)
select_model_element_9 = DSModelElementSelection()  # 1 picked in the model
point_11 = ReferencePoint.Point(select_model_element_9)
create_2 = List.Create(point, point_2, point_3, point_4, point_5, point_6, point_7, point_8, point_9, point_10, point_11)
byCurvesAndPoints = TriangleRigging.TriangleSpline.ByCurvesAndPoints(curve, create_2)
getSplines = TriangleRigging.TriangleSpline.GetSplines(byCurvesAndPoints)
bySolidsPointsPoints = TriangleRigging.TriangleRigging.BySolidsPointsPoints(geometry, locations, getSplines)
triangles = TriangleRigging.TriangleRigging.Triangles(bySolidsPointsPoints)
getSortedTriangleIndexByName = TriangleRigging.TriangleRigging.GetSortedTriangleIndexByName(bySolidsPointsPoints)
getItemAtIndex = List.GetItemAtIndex(list=triangles, index=getSortedTriangleIndexByName)
code_block = CodeBlock { inchtoft(1/4); }
getEdgeLabels = TriangleRigging.Triangle.GetEdgeLabels(getItemAtIndex, code_block)
string = StringInput("C:\Users\be'cause we can\Documents\GitHub\BecauseWeDynamo\sample\TriangleRigging\sampleOutputLabels.dxf")
byPolyCurves = Utilities.ExportCurvesAsLinesToDXF.ByPolyCurves(getEdgeLabels, string)
code_block_2 = CodeBlock()
# ---------- code_block_2.designscript (3 lines) ----------
def inchtoft(input) {
 return = input/12;
};
# ----------------------------------------
