# Dynamo graph sampleExportSheets.dyn (Dynamo 0.8.2.1601)

family_types = FamilyTypes("Triangle Rig:Clear")
all_elements_of_family_type = ElementsOfFamilyType(family_types)
family_types_2 = FamilyTypes("Triangle Rig:Solid")
all_elements_of_family_type_2 = ElementsOfFamilyType(family_types_2)
family_types_3 = FamilyTypes("Triangle Rig:Base")
all_elements_of_family_type_3 = ElementsOfFamilyType(family_types_3)
join = List.Join(all_elements_of_family_type, all_elements_of_family_type_2, all_elements_of_family_type_3)
geometry = Element.Geometry(join)
locations = AdaptiveComponent.Locations(join)
element_types = ElementTypes("CurveElement")
all_elements_of_type = ElementsOfType(element_types)
curve = CurveElement.Curve(all_elements_of_type)
select_model_element = DSModelElementSelection()  # 1 picked in the model
point = ReferencePoint.Point(select_model_element)
select_model_elements = DSModelElementsSelection()  # 1 picked in the model
point_2 = ReferencePoint.Point(select_model_elements)
select_model_element_2 = DSModelElementSelection()  # 1 picked in the model
point_3 = ReferencePoint.Point(select_model_element_2)
select_model_element_3 = DSModelElementSelection()  # 1 picked in the model
point_4 = ReferencePoint.Point(select_model_element_3)
select_model_element_4 = DSModelElementSelection()  # 1 picked in the model
point_5 = ReferencePoint.Point(select_model_element_4)
select_model_element_5 = DSModelElementSelection()  # 1 picked in the model
point_6 = ReferencePoint.Point(select_model_element_5)
select_model_element_6 = DSModelElementSelection()  # 1 picked in the model
point_7 = ReferencePoint.Point(select_model_element_6)
select_model_elements_2 = DSModelElementsSelection()  # 1 picked in the model
point_8 = ReferencePoint.Point(select_model_elements_2)
select_model_element_7 = DSModelElementSelection()  # 1 picked in the model
point_9 = ReferencePoint.Point(select_model_element_7)
select_model_element_8 = DSModelElementSelection()  # 1 picked in the model
point_10 = ReferencePoint.Point(select_model_element_8)
select_model_element_9 = DSModelElementSelection()  # 1 picked in the model
point_11 = ReferencePoint.Point(select_model_element_9)
create = List.Create(point, point_2, point_3, point_4, point_5, point_6, point_7, point_8, point_9, point_10, point_11)
byCurvesAndPoints = Fabrication.TriangleSpline.ByCurvesAndPoints(curve, create)
getSplines = Fabrication.TriangleSpline.GetSplines(byCurvesAndPoints)
bySolidsPointsPoints = Fabrication.TriangleRigging.BySolidsPointsPoints(geometry, locations, getSplines)
triangles = Fabrication.TriangleRigging.Triangles(bySolidsPointsPoints)
getSortedTriangleIndicesByName = Fabrication.TriangleRigging.GetSortedTriangleIndicesByName(bySolidsPointsPoints)
getItemAtIndex = List.GetItemAtIndex(list=triangles, index=getSortedTriangleIndicesByName)
surface = Fabrication.Triangle.surface(getItemAtIndex)
name = Fabrication.Triangle.name(getItemAtIndex)
byDefault = Utilities.ExportCurvesAsArcsToDXF.ByDefault()
string = StringInput("C:\Users\be'cause we can\Documents\GitHub\BecauseWeDynamo\sample\TriangleRigging\")
string_2 = StringInput("sampleSheets")
concat = String.Concat(string, string_2)
writeFile = Utilities.ExportCurvesAsArcsToDXF.WriteFile(byDefault, concat)
number = DoubleInput(1)
number_2 = DoubleInput(12)
number_3 = DoubleInput(16)
mul = number_2 * number_3
div = number / mul
getEdgeLabels = Fabrication.Triangle.GetEdgeLabels(getItemAtIndex, div)
contextCoordinateSystem = Fabrication.Triangle.contextCoordinateSystem(getItemAtIndex)
byPolyCurvesAndCS = Fabrication.Sheets.ByPolyCurvesAndCS(getEdgeLabels, contextCoordinateSystem)
code_block = CodeBlock { {0..24,25..62,63..103,104..152,153..190,191..228,229..266,267..288,289..302,303..308}; }
number_4 = DoubleInput(3)
number_5 = DoubleInput(0..9)
number_6 = DoubleInput(2)
mul_2 = number_5 * number_6
getPolyCurveIndexAsRow = Fabrication.Sheets.GetPolyCurveIndexAsRow(byPolyCurvesAndCS, code_block, number_4, mul_2)
number_7 = DoubleInput(1)
flatten = List.Flatten(list=getPolyCurveIndexAsRow, amt=number_7)
string_3 = StringInput("LABELS")
number_8 = DoubleInput(1)
addPolyCurves = Utilities.ExportCurvesAsArcsToDXF.AddPolyCurves(byDefault, flatten, string_3, number_8)
perimeterCurves = Fabrication.Triangle.PerimeterCurves(getItemAtIndex)
byCurvesAndCS = Fabrication.Sheets.ByCurvesAndCS(perimeterCurves, contextCoordinateSystem)
getPolyCurveIndexAsRow_2 = Fabrication.Sheets.GetPolyCurveIndexAsRow(byCurvesAndCS, code_block, number_4, mul_2)
flatten_2 = List.Flatten(list=getPolyCurveIndexAsRow_2, amt=number_7)
string_4 = StringInput("SHAPES")
number_9 = DoubleInput(3)
addPolyCurves_2 = Utilities.ExportCurvesAsArcsToDXF.AddPolyCurves(addPolyCurves, flatten_2, string_4, number_9)
number_10 = DoubleInput(1)
number_11 = DoubleInput(1)
number_12 = DoubleInput(12)
number_13 = DoubleInput(16)
mul_3 = number_12 * number_13
div_2 = number_11 / mul_3
number_14 = DoubleInput(11)
number_15 = DoubleInput(12)
number_16 = DoubleInput(16)
mul_4 = number_15 * number_16
div_3 = number_14 / mul_4
placeHoles = Fabrication.Triangle.PlaceHoles(getItemAtIndex, number_10, div_2, div_3)
byCirclesAndCS = Fabrication.Sheets.ByCirclesAndCS(placeHoles, contextCoordinateSystem)
getCircleIndexAsRow = Fabrication.Sheets.GetCircleIndexAsRow(byCirclesAndCS, code_block, number_4, mul_2)
flatten_3 = List.Flatten(list=getCircleIndexAsRow, amt=number_7)
string_5 = StringInput("HOLES")
number_17 = DoubleInput(2)
addCircles = Utilities.ExportCurvesAsArcsToDXF.AddCircles(addPolyCurves_2, flatten_3, string_5, number_17)
