# Dynamo graph sampleExportSheets.dyn (Dynamo 0.8.2.1601)

byDefault = Utilities.ExportCurvesAsArcsToDXF.ByDefault()
string = StringInput("C:\Users\be'cause we can\Documents\GitHub\BecauseWeDynamo\sample\TriangleRiggingSmall\")
string_2 = StringInput("sampleSheets")
concat = String.Concat(string, string_2)
writeFile = Utilities.ExportCurvesAsArcsToDXF.WriteFile(byDefault, concat)
family_types = FamilyTypes("Triangle Rig:Solid")
all_elements_of_family_type = ElementsOfFamilyType(family_types)
geometry = Element.Geometry(all_elements_of_family_type)
locations = AdaptiveComponent.Locations(all_elements_of_family_type)
element_types = ElementTypes("CurveElement")
all_elements_of_type = ElementsOfType(element_types)
curve = CurveElement.Curve(all_elements_of_type)
select_model_element = DSModelElementSelection()  # 1 picked in the model
point = ReferencePoint.Point(select_model_element)
select_model_elements = DSModelElementsSelection()  # 1 picked in the model
point_2 = ReferencePoint.Point(select_model_elements)
select_model_element_2 = DSModelElementSelection()  # 1 picked in the model
point_3 = ReferencePoint.Point(select_model_element_2)
select_model_element_3 = DSModelElementSelection()  # 1 picked in the model
point_4 = ReferencePoint.Point(select_model_element_3)
create = List.Create(point, point_2, point_3, point_4)
byCurvesAndPoints = TriangleRigging.TriangleSpline.ByCurvesAndPoints(curve, create)
getSplines = TriangleRigging.TriangleSpline.GetSplines(byCurvesAndPoints)
bySolidsPointsPoints = TriangleRigging.TriangleRigging.BySolidsPointsPoints(geometry, locations, getSplines)
triangles = TriangleRigging.TriangleRigging.Triangles(bySolidsPointsPoints)
getSortedTriangleIndexByName = TriangleRigging.TriangleRigging.GetSortedTriangleIndexByName(bySolidsPointsPoints)
getItemAtIndex = List.GetItemAtIndex(list=triangles, index=getSortedTriangleIndexByName)
scaling_factor = CodeBlock { inchtoft(1/16); }
getEdgeLabels = TriangleRigging.Triangle.GetEdgeLabels(getItemAtIndex, scaling_factor)
contextCoordinateSystem = TriangleRigging.Triangle.contextCoordinateSystem(getItemAtIndex)
byPolyCurvesAndCS = Fabrication.Sheets.ByPolyCurvesAndCS(getEdgeLabels, contextCoordinateSystem)
getTriangleRowIndexBySpline = TriangleRigging.TriangleRigging.GetTriangleRowIndexBySpline(bySolidsPointsPoints)
x_spacing = DoubleInput(3)
count = List.Count(getSplines)
code_block = CodeBlock(input=count) { numRows(input); }
y_spacing = DoubleInput(2)
mul = code_block * y_spacing
getPolyCurveIndexAsRow = Fabrication.Sheets.GetPolyCurveIndexAsRow(byPolyCurvesAndCS, getTriangleRowIndexBySpline, x_spacing, mul)
number = DoubleInput(1)
flatten = List.Flatten(list=getPolyCurveIndexAsRow, amt=number)
string_3 = StringInput("LABELS")
number_2 = DoubleInput(1)
addPolyCurves = Utilities.ExportCurvesAsArcsToDXF.AddPolyCurves(byDefault, flatten, string_3, number_2)
perimeterCurves = TriangleRigging.Triangle.PerimeterCurves(getItemAtIndex)
byCurvesAndCS = Fabrication.Sheets.ByCurvesAndCS(perimeterCurves, contextCoordinateSystem)
getPolyCurveIndexAsRow_2 = Fabrication.Sheets.GetPolyCurveIndexAsRow(byCurvesAndCS, getTriangleRowIndexBySpline, x_spacing, mul)
flatten_2 = List.Flatten(list=getPolyCurveIndexAsRow_2, amt=number)
string_4 = StringInput("SHAPES")
number_3 = DoubleInput(3)
addPolyCurves_2 = Utilities.ExportCurvesAsArcsToDXF.AddPolyCurves(addPolyCurves, flatten_2, string_4, number_3)
holes = DoubleInput(2)
radius = CodeBlock { inchtoft(1/16); }
spacing = CodeBlock { inchtoft(11/16); }
placeHoles = TriangleRigging.Triangle.PlaceHoles(getItemAtIndex, holes, radius, spacing)
byCirclesAndCS = Fabrication.Sheets.ByCirclesAndCS(placeHoles, contextCoordinateSystem)
getCircleIndexAsRow = Fabrication.Sheets.GetCircleIndexAsRow(byCirclesAndCS, getTriangleRowIndexBySpline, x_spacing, mul)
flatten_3 = List.Flatten(list=getCircleIndexAsRow, amt=number)
string_5 = StringInput("HOLES")
number_4 = DoubleInput(2)
addCircles = Utilities.ExportCurvesAsArcsToDXF.AddCircles(addPolyCurves_2, flatten_3, string_5, number_4)
code_block_2 = CodeBlock()
# ---------- code_block_2.designscript (6 lines) ----------
def numRows(input) {
 return = 0..input-2;
};
def inchtoft(dimInches) {
 return = dimInches/12;
};
# ----------------------------------------
name = TriangleRigging.Triangle.name(getItemAtIndex)
surface = TriangleRigging.Triangle.surface(getItemAtIndex)
