# Dynamo graph sampleGeometry.dyn (Dynamo 0.8.0.950)

element_types = ElementTypes("CurveElement")
all_elements_of_type = ElementsOfType(element_types)
curve = CurveElement.Curve(all_elements_of_type)
select_model_element = DSModelElementSelection()  # 1 picked in the model
point = ReferencePoint.Point(select_model_element)
select_model_elements = DSModelElementsSelection()  # 1 picked in the model
point_2 = ReferencePoint.Point(select_model_elements)
select_model_element_2 = DSModelElementSelection()  # 1 picked in the model
point_3 = ReferencePoint.Point(select_model_element_2)
select_model_element_3 = DSModelElementSelection()  # 1 picked in the model
point_4 = ReferencePoint.Point(select_model_element_3)
create = List.Create(point, point_2, point_3, point_4)
byCurvesAndPoints = TriangleRigging.TriangleSpline.ByCurvesAndPoints(curve, create)
getSplines = TriangleRigging.TriangleSpline.GetSplines(byCurvesAndPoints)
triangles = TriangleRigging.TriangleRigging.Triangles()
getSortedTriangleIndexByName = TriangleRigging.TriangleRigging.GetSortedTriangleIndexByName()
getItemAtIndex = List.GetItemAtIndex(list=triangles, index=getSortedTriangleIndexByName)
code_block = CodeBlock()
# ---------- code_block.designscript (5 lines) ----------
def inchtoft(input) {
 return = input/12;
}

inchtoft(1/4);
# ----------------------------------------
getEdgeLabels = TriangleRigging.Triangle.GetEdgeLabels(getItemAtIndex, code_block)
family_types = FamilyTypes("Triangle Rig:Solid")
all_elements_of_family_type = ElementsOfFamilyType(family_types)
geometry = Element.Geometry(all_elements_of_family_type)
locations = AdaptiveComponent.Locations(all_elements_of_family_type)
select_model_element_4 = DSModelElementSelection()  # 1 picked in the model
point_5 = ReferencePoint.Point(select_model_element_4)
select_model_element_5 = DSModelElementSelection()  # 1 picked in the model
point_6 = ReferencePoint.Point(select_model_element_5)
select_model_element_6 = DSModelElementSelection()  # 1 picked in the model
point_7 = ReferencePoint.Point(select_model_element_6)
create_2 = List.Create(point_5, point_6, point_7)
bySolidsPointsPoints = TriangleRigging.TriangleRigging.BySolidsPointsPoints(geometry, locations, create_2)
