# Dynamo graph sampleTriangleEdgeConnector.dyn (Dynamo 0.8.0.950)

code_block = CodeBlock()
# ---------- code_block.designscript (3 lines) ----------
def inchtoft(input) {
 return = input/12;
};
# ----------------------------------------
family_types = FamilyTypes("Triangle Rig:Solid")
all_elements_of_family_type = ElementsOfFamilyType(family_types)
geometry = Element.Geometry(all_elements_of_family_type)
locations = AdaptiveComponent.Locations(all_elements_of_family_type)
element_types = ElementTypes("CurveElement")
all_elements_of_type = ElementsOfType(element_types)
curve = CurveElement.Curve(all_elements_of_type)
select_model_element = DSModelElementSelection()  # 1 picked in the model
point = ReferencePoint.Point(select_model_element)
select_model_elements = DSModelElementsSelection()  # 1 picked in the model
point_2 = ReferencePoint.Point(select_model_elements)
select_model_element_2 = DSModelElementSelection()  # 1 picked in the model
point_3 = ReferencePoint.Point(select_model_element_2)
select_model_element_3 = DSModelElementSelection()  # 1 picked in the model
point_4 = ReferencePoint.Point(select_model_element_3)
create = List.Create(point, point_2, point_3, point_4)
byCurvesAndPoints = TriangleRigging.TriangleSpline.ByCurvesAndPoints(curve, create)
getSplines = TriangleRigging.TriangleSpline.GetSplines(byCurvesAndPoints)
bySolidsPointsSplines = TriangleRigging.TriangleRigging.BySolidsPointsSplines(geometry, locations, getSplines)
triangles = TriangleRigging.TriangleRigging.Triangles(bySolidsPointsSplines)
getSortedTriangleIndexByName = TriangleRigging.TriangleRigging.GetSortedTriangleIndexByName(bySolidsPointsSplines)
getItemAtIndex = List.GetItemAtIndex(list=triangles, index=getSortedTriangleIndexByName)
perimeterCurves = TriangleRigging.Triangle.PerimeterCurves(getItemAtIndex)
integer_slider = IntegerSlider(5, range=4..7 step 1)
count = List.Count(create)
numHoles = DoubleInput(2)
code_block_2 = CodeBlock(count, numHoles) { n = 0..SplineCount-1; z[n] = numHoles; }
code_block_3 = CodeBlock { inchtoft(1/16); }
code_block_4 = CodeBlock { inchtoft(11/16); }
placeEdgeConnectorHolesBySpline = TriangleRigging.TriangleRigging.PlaceEdgeConnectorHolesBySpline(bySolidsPointsSplines, code_block_2.out1, code_block_3, code_block_4)
getEdgeConnectorByHoleCount = TriangleRigging.TriangleRigging.GetEdgeConnectorByHoleCount(bySolidsPointsSplines, integer_slider, placeEdgeConnectorHolesBySpline)
edge = TriangleRigging.TriangleEdgeConnector.edge(getEdgeConnectorByHoleCount)
getEdgeGeometry = TriangleRigging.TriangleEdge.GetEdgeGeometry(edge)
code_block_5 = CodeBlock { inchtoft(1/4); }
getEdgeLabels = TriangleRigging.TriangleEdge.GetEdgeLabels(edge, code_block_5)
